# Grasshopper definition 230117_Gantry_Debug_Update.ghx (Grasshopper 1.0.7)

ip_of_the_nuc = Panel("192.168.0.112")
ros = ROSConnect(ip=ip_of_the_nuc, connect=Toggle(True))  # -> ros_client, is_connected; inputs port: Int32, connect: Boolean
#   port ip: The ip address ROS. Defaults to 127.0.0.1.
#   port port: The port of ROS. Defaults to 9090.
#   port connect: If True, connects to ROS. If False, disconnects from ROS. Defaults to False.
#   port ros_client: The ROS client.
#   port is_connected: True if connection established.
# ---------- ros: Python ----------
"""
Connect or disconnect to ROS.

COMPAS FAB v0.25.0
"""
from ghpythonlib.componentbase import executingcomponent as component
from scriptcontext import sticky as st

from compas_fab.backends import RosClient
from compas_fab.ghpython.components import create_id


class ROSConnect(component):
    def RunScript(self, ip, port, connect):
        ros_client = None

        ip = ip or '127.0.0.1'
        port = port or 9090

        key = create_id(self, 'ros_client')
        ros_client = st.get(key, None)

        if ros_client:
            st[key].close()
        if connect:
            st[key] = RosClient(ip, port)
            st[key].run(5)

        ros_client = st.get(key, None)
        is_connected = ros_client.is_connected if ros_client else False
        return (ros_client, is_connected)
# ---------- end ros ----------
panel = Panel(ros.is_connected)

# ----
# Start 2
# 3...
list = ValueList({"moog_stop": "0", "moog_reset": "6", "moog_enable": "15"}, selected="moog_enable")
# True - whole cycle
# False - one by one actuation
# Manual mode 1
toggle = BooleanToggle(False)
rps = Slider(27, range=0..33)
rpm = Slider(2500, range=0..2500)

# ----
# 1.  Mode Selection
python = GhPythonScript(x=toggle)  # -> out, msg
# ---------- python: Python ----------
import json

if x:
    msg = json.dumps({'data': True})
else:
    msg = json.dumps({'data': False})
# ---------- end python ----------
output = Panel(python.msg)
publish = PublishToTopic(ros_client=ros.ros_client, topic_name="/controllino/manual_button", topic_type="std_msgs/Bool", msg=python.msg)  # -> topic, is_advertised
#   port ros_client: The ROS client.
#   port topic_name: Name of the topic to publish to, eg. /joint_states
#   port topic_type: Type of the topic to publish to, eg. sensor_msgs/JointState
#   port msg: The message to publish. It can be an instance of ROSMsg, a Python dict, or a JSON string.
#   port topic: The topic instance.
#   port is_advertised: Indicates if the topic is current advertised or not.
# ---------- publish: Python ----------
"""
Publishes messages to a ROS topic

COMPAS FAB v0.25.0
"""
import time

from ghpythonlib.componentbase import executingcomponent as component
from roslibpy import Topic
from scriptcontext import sticky as st

from compas_fab.backends.ros.messages import ROSmsg
from compas_fab.ghpython.components import create_id


class ROSTopicPublish(component):
    def RunScript(self, ros_client, topic_name, topic_type, msg):
        if not topic_name:
            raise ValueError('Please specify the name of the topic')
        if not topic_type:
            raise ValueError('Please specify the type of the topic')

        key = create_id(self, 'topic')

        topic = st.get(key, None)

        if ros_client and ros_client.is_connected:
            if not topic or topic.ros != ros_client:
                topic = Topic(ros_client, topic_name, topic_type, reconnect_on_close=False)
                topic.advertise()
                time.sleep(0.2)

                st[key] = topic

        self.is_advertised = topic and topic.is_advertised

        if msg:
            msg = ROSmsg.parse(msg, topic_type)
            topic.publish(msg.msg)
            self.Message = 'Message published'
        else:
            if self.is_advertised:
                self.Message = 'Topic advertised'

        return (topic, self.is_advertised)
# ---------- end publish ----------
panel_2 = Panel(publish.topic)
panel_3 = Panel(publish.is_advertised)

python_2 = GhPythonScript(x=Toggle(False))  # -> out, msg; same code as python
# 2. Start Button
panel_4 = Panel("/controllino/digital_start_button")
output_2 = Panel(python_2.msg)
publish_2 = PublishToTopic(ros_client=ros.ros_client, topic_name=panel_4, topic_type="std_msgs/Bool", msg=python_2.msg)  # -> topic, is_advertised; same code as publish
panel_5 = Panel(publish_2.topic)
panel_6 = Panel(publish_2.is_advertised)

# ----
# 3. Extruder
python_3 = GhPythonScript(x=Toggle(False))  # -> out, msg; same code as python
output_3 = Panel(python_3.msg)
publish_3 = PublishToTopic(ros_client=ros.ros_client, topic_name="/controllino/manual_motor", topic_type="std_msgs/Bool", msg=python_3.msg)  # -> topic, is_advertised; same code as publish
panel_7 = Panel(publish_3.topic)
panel_8 = Panel(publish_3.is_advertised)

# ----
# 4. Extruder Speed
panel_9 = Panel("/controllino/extruder_motor_set_speed")
python_4 = GhPythonScript(x=rpm)  # -> out, msg
# ---------- python_4: Python ----------
import json

msg = json.dumps({'data':x })
#else:
#    msg = json.dumps({'data': 1000})
# ---------- end python_4 ----------
output_4 = Panel(python_4.msg)
publish_4 = PublishToTopic(ros_client=ros.ros_client, topic_name=panel_9, topic_type="std_msgs/Float64", msg=python_4.msg)  # -> topic, is_advertised; same code as publish
panel_10 = Panel(publish_4.topic)
panel_11 = Panel(publish_4.is_advertised)

python_5 = GhPythonScript(x=Toggle(False))  # -> out, msg; same code as python
# 5. Cutting Piston
panel_12 = Panel("/controllino/manual_piston")
output_5 = Panel(python_5.msg)
publish_5 = PublishToTopic(ros_client=ros.ros_client, topic_name=panel_12, topic_type="std_msgs/Bool", msg=python_5.msg)  # -> topic, is_advertised; same code as publish
panel_13 = Panel(publish_5.topic)
panel_14 = Panel(publish_5.is_advertised)

python_6 = GhPythonScript(x=Toggle(False))  # -> out, msg; same code as python
# 6. Gripper
panel_15 = Panel("/controllino/manual_gripper")
output_6 = Panel(python_6.msg)
publish_6 = PublishToTopic(ros_client=ros.ros_client, topic_name=panel_15, topic_type="std_msgs/Bool", msg=python_6.msg)  # -> topic, is_advertised; same code as publish
panel_16 = Panel(publish_6.topic)
panel_17 = Panel(publish_6.is_advertised)

python_7 = GhPythonScript(send=Toggle(False), x=rps)  # -> out, msg
# ---------- python_7: Python ----------
import json

if send:
    msg = json.dumps({'velocity':x })
else:
    msg = json.dumps({'velocity':0 })
#else:
#    msg = json.dumps({'data': 1000})
# ---------- end python_7 ----------
# 6. Shooting belt Speed
panel_18 = Panel("impact_printing_msgs/MoogActuatorCommand")
output_7 = Panel(python_7.msg)
publish_7 = PublishToTopic(ros_client=ros.ros_client, topic_name="/moog_actuator_command", topic_type=panel_18, msg=python_7.msg)  # -> topic, is_advertised; same code as publish
panel_19 = Panel(publish_7.topic)
panel_20 = Panel(publish_7.is_advertised)

python_8 = GhPythonScript(x=Button())  # -> out, msg; same code as python
# 6. Shoot !!
panel_21 = Panel("/controllino/digital_shoot_button")
publish_8 = PublishToTopic(ros_client=ros.ros_client, topic_name=panel_21, topic_type="std_msgs/Bool", msg=python_8.msg)  # -> topic, is_advertised; same code as publish
output_8 = Panel(python_8.msg)
panel_22 = Panel(publish_8.is_advertised)
panel_23 = Panel(publish_8.topic)

# ----
# 7. Clear Trajectory
service_call = GhPythonScript(ros=ros.ros_client, button=Button())  # -> out, result
# ---------- service_call: Python ----------
__author__ = "kchadha"
__version__ = "2022.12.05"

import time

from ghpythonlib.componentbase import executingcomponent as component
from roslibpy import Topic
import roslibpy
from scriptcontext import sticky as st
from compas_fab.backends.ros.messages import ROSmsg
from compas_fab.ghpython.components import create_id
import roslibpy
from time import sleep

#client = roslibpy.Ros(host='mabi-pc', port=9090)
#client.run()
if button:
    service = roslibpy.Service(ros, '/clear_trajectory', 'std_srvs/SetBool')
    if button:
        request = roslibpy.ServiceRequest({'data': True})
    else:
        request = roslibpy.ServiceRequest({'data': False})
#    print('Calling service...')
    result = service.call(request,timeout = 5)
    print('Service response: {}'.format(result))
    sleep(2)
#    ros.terminate()
# ---------- end service_call ----------

# ----
# 2.  Light Barrier
panel_24 = Panel("/controllino/light_barrier")
subscribe = SubscribeToTopic(
    ros_client=ros.ros_client,
    topic_name=panel_24,
    topic_type="std_msgs/Bool",
    interval="100",
    start=Button(),
    stop=Button())  # -> topic, last_msg, is_subscribed; inputs interval: Int32, start: Boolean, stop: Boolean
#   port ros_client: The ROS client.
#   port topic_name: Name of the topic to subscribe to, eg. /joint_states
#   port topic_type: Type of the topic to subscribe to, eg. sensor_msgs/JointState
#   port interval: Interval in milliseconds at which to expire the solution to propagate received messages. Defaults to 25ms. Messages are not queued, so if the interval is greater than the rate at which messages are published, some messages will be dropped.
#   port start: Start receiving messages.
#   port stop: Stop receiving messages.
#   port topic: The subscribed topic instance.
#   port last_msg: The last received message.
#   port is_subscribed: Indicates if the topic is currently subscribed or not.
# ---------- subscribe: Python ----------
"""
Subscribe to a ROS topic.

COMPAS FAB v0.24.0
"""
import time

import Grasshopper.Kernel
from ghpythonlib.componentbase import executingcomponent as component
from roslibpy import Topic
from scriptcontext import sticky as st
from roslibpy import Service

#from compas_fab.backends.ros import ROSmsg
from compas_fab.backends.ros.messages import ROSmsg
from compas_fab.ghpython.components import create_id


class ROSTopicSubscribe(component):
    def RunScript(self, ros_client, topic_name, topic_type, interval, start, stop):
        if not topic_name:
            raise ValueError('Please specify the name of the topic')
        if not topic_type:
            raise ValueError('Please specify the type of the topic')

        if not hasattr(self, 'message_count'):
            self.message_count = 0

        self.interval = interval or 25  # in milliseconds
        self.is_updating = False
        self.is_subscribed = False

        self.msg_key = create_id(self, 'last_msg')
        key = create_id(self, 'topic')

        last_msg = st.get(self.msg_key, None)
        topic = st.get(key, None)

        if ros_client and ros_client.is_connected:
            if start:
                self._unsubscribe(topic)

                topic = Topic(ros_client, topic_name, topic_type)
                topic.subscribe(self.topic_callback)
                time.sleep(0.2)

                st[key] = topic

            if stop:
                self._unsubscribe(topic)

        self.is_subscribed = topic and topic.is_subscribed

        if last_msg:
            last_msg = ROSmsg.parse(last_msg, topic_type)

        if self.is_subscribed:
            self.Message = 'Subscribed, {} messages'.format(self.message_count)
        else:
            self.Message = 'Not subscribed'

        return (topic, last_msg, self.is_subscribed)

    def _unsubscribe(self, topic):
        if topic and topic.is_subscribed:
            topic.unsubscribe()
            time.sleep(0.2)

    def topic_callback(self, msg):
        self.message_count += 1
        st[self.msg_key] = msg

        if self.is_subscribed:
            ghdoc = ghenv.Component.OnPingDocument()     # noqa: F821 This is defined by Grasshopper
            if not self.is_updating and ghdoc.SolutionState != Grasshopper.Kernel.GH_ProcessStep.Process:
                self.is_updating = True
                ghdoc.ScheduleSolution(
                    self.interval, Grasshopper.Kernel.GH_Document.GH_ScheduleDelegate(self.expire_callback))

    def expire_callback(self, ghdoc):
        if ghdoc.SolutionState != Grasshopper.Kernel.GH_ProcessStep.Process:
            ghenv.Component.ExpireSolution(False)        # noqa: F821 This is defined by Grasshopper
        self.is_updating = False
# ---------- end subscribe ----------
python_9 = GhPythonScript(x=subscribe.last_msg)  # -> out, a
# ---------- python_9: Python ----------
__author__ = "kchadha"
__version__ = "2022.08.18"

import rhinoscriptsyntax as rs
print x
# ---------- end python_9 ----------
panel_25 = Panel(python_9.out)

# ----
# 4. Shooting Mechanism TCP
panel_26 = Panel("/waypoint_feedback")
# >>>>>>    Publisher
panel_27 = Panel("impact_printing_msgs/WaypointState")
subscribe_2 = SubscribeToTopic(ros_client=ros.ros_client, topic_name=panel_26, topic_type=panel_27, interval="100", start=Button(), stop=Button())  # -> topic, last_msg, is_subscribed; inputs interval: Int32, start: Boolean, stop: Boolean; same code as subscribe
python_10 = GhPythonScript(x=subscribe_2.last_msg)  # -> out, a; same code as python_9
panel_28 = Panel(python_10.out)

# ----
# 3.  Gantry 11 position
panel_29 = Panel("/current_tool_position")
subscribe_3 = SubscribeToTopic(
    ros_client=ros.ros_client,
    topic_name=panel_29,
    topic_type="sensor_msgs/JointState",
    interval="100",
    start=Button(),
    stop=Button())  # -> topic, last_msg, is_subscribed; inputs interval: Int32, start: Boolean, stop: Boolean; same code as subscribe
python_11 = GhPythonScript(x=subscribe_3.last_msg)  # -> out, a; same code as python_9
panel_30 = Panel(python_11.out)

# ----
# 7. Shooting belt Toggle
service_call_2 = GhPythonScript(ros=ros.ros_client, command=list, button=Button())  # -> out, result; inputs command: Int32
# ---------- service_call_2: Python ----------
__author__ = "kchadha"
__version__ = "2022.12.05"

import time

from ghpythonlib.componentbase import executingcomponent as component
from roslibpy import Topic
import roslibpy
from scriptcontext import sticky as st
from compas_fab.backends.ros.messages import ROSmsg
from compas_fab.ghpython.components import create_id
import roslibpy
from time import sleep

#client = roslibpy.Ros(host='mabi-pc', port=9090)
#client.run()
if button:
    service = roslibpy.Service(ros, '/moog_device_state', 'impact_printing_msgs/StateTransition')
    request = roslibpy.ServiceRequest({'command': command})
    print('Calling service...')
    result = service.call(request,timeout = 5)
    print('Service response: {}'.format(result))
    sleep(2)
#    ros.terminate()
# ---------- end service_call_2 ----------
panel_31 = Panel(service_call_2.result)

panel_32 = Panel("""	(gripper_motor)


 0 = 	 " stop_all",
 1 = 	 " release_start",
 2 = 	 " grip_stop",
 3 = 	 " release_stop",
 4 = 	 " manual"
""")

# ---- group: Subscriber to PolygonStamped
# <<<<<<    Subscriber
# 1.  Check Tool State
panel_33 = Panel("/controllino/tool_state")
subscribe_4 = SubscribeToTopic(
    ros_client=ros.ros_client,
    topic_name=panel_33,
    topic_type="std_msgs/Int32",
    interval="1000",
    start=Button(),
    stop=Button())  # -> topic, last_msg, is_subscribed; inputs interval: Int32, start: Boolean, stop: Boolean; same code as subscribe

# ----
python_12 = GhPythonScript(x=subscribe_4.last_msg)  # -> out, a; same code as python_9

# ---- group: Subscriber to PolygonStamped (continued)
panel_34 = Panel(python_12.out)
