# Grasshopper definition 230117_Gantry_ProductionFile_Update.ghx (Grasshopper 1.0.7)

ip_of_the_nuc = Panel("192.168.0.112")

# ----
# Load classes from src
button = Button()
add_paths_from_local_dir = GhPythonScript(reload=button)  # -> dire
# ---------- add_paths_from_local_dir: Python ----------
import os
import sys

#get current file path
path = ghenv.Component.OnPingDocument().FilePath
#get parent directory of the parent directory
parentdir = os.path.dirname(os.path.dirname(path))
#go to root folder
root = os.path.dirname(parentdir)
#get src folder which contains classes
dire = os.path.join(root,'src','impact_printing_design')

print dire
#add path to sys
sys.path.append(dire)

ghenv.Component.Message = "paths added"

from compas_rhino import unload_modules

if reload:
    unload_modules("design")
    unload_modules("planning")
    
    ghenv.Component.Message = "paths updated"
# ---------- end add_paths_from_local_dir ----------
panel = Panel(add_paths_from_local_dir)

pt = Point([Point(19979.5, 9432.39, 2100), Point(19967.90239, 9950.659608, 402.69), Point(19962.01793, 9883.955008, 402.69), Point(19936.02531, 9823.375433, 402.69), Point(19884.26654, 9781.010736, 402.69), Point(19833.9259, 9737.179411, 402.69)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])  # disabled
crv = Curve(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)
generate_design_from_crv = GhPythonScript(
    input_crv=crv,
    h_spacing=Slider(70, range=0..100),
    v_spacing=Slider(32, range=0..100),
    height=Slider(2000, range=40..2000),
    prototype_name="straightWall",
    extra_text="LV")  # -> points, global_design; inputs input_crv: Curve
# ---------- generate_design_from_crv: Python ----------
from design import GlobalDesign
from ghpythonlib.treehelpers import list_to_tree as _tree


prototype_identifier = prototype_name + "_" +  extra_text

global_design= GlobalDesign.design_from_curve(input_crv, h_spacing, height, v_spacing, prototype_identifier)

#generate uid
global_design.generate_uid_for_all_parts()
points = global_design.visualize()

#Convert to tree to visualize
points = _tree(points)
# ---------- end generate_design_from_crv ----------
ros = ROSConnect(ip=ip_of_the_nuc, connect=Toggle(False))  # -> ros_client, is_connected; inputs port: Int32, connect: Boolean
#   port ip: The ip address ROS. Defaults to 127.0.0.1.
#   port port: The port of ROS. Defaults to 9090.
#   port connect: If True, connects to ROS. If False, disconnects from ROS. Defaults to False.
#   port ros_client: The ROS client.
#   port is_connected: True if connection established.
# ---------- ros: Python ----------
"""
Connect or disconnect to ROS.

COMPAS FAB v0.25.0
"""
from ghpythonlib.componentbase import executingcomponent as component
from scriptcontext import sticky as st

from compas_fab.backends import RosClient
from compas_fab.ghpython.components import create_id


class ROSConnect(component):
    def RunScript(self, ip, port, connect):
        ros_client = None

        ip = ip or '127.0.0.1'
        port = port or 9090

        key = create_id(self, 'ros_client')
        ros_client = st.get(key, None)

        if ros_client:
            st[key].close()
        if connect:
            st[key] = RosClient(ip, port)
            st[key].run(5)
        if not connect:
            ros_client.terminate()

#        if terminate:
#            ros_client.terminate()

        ros_client = st.get(key, None)
        is_connected = ros_client.is_connected if ros_client else False
        return (ros_client, is_connected)
# ---------- end ros ----------
panel_2 = Panel("00-00-05")
panel_3 = Panel(ros.is_connected)
plan_sequence = GhPythonScript(
    design=generate_design_from_crv.global_design,
    toolpath_volume=Slider(28, range=0..100),
    feeding_pt="25280,9430,450",
    n=Slider(0, range=0..15))  # -> sequencer, points, tool_curve, msgs; inputs toolpath_volume: Int32, feeding_pt: Point3d, n: Int32
# ---------- plan_sequence: Python ----------
from planning import ConstructionSequencer


sequencer = ConstructionSequencer(design, toolpath_volume)
sequencer.generate_toolpaths_continuous(start_uid)
print sequencer.targets_flat
toolpath = sequencer.toolpaths[n]
toolpath.add_safety_points()
toolpath.create_feeding_trajectory(feeding_pt)


points, tool_curve = toolpath.visualize_pts()
msgs_dict, msgs = toolpath.export_toolpath_to_ROS()
# ---------- end plan_sequence ----------
panel_4 = Panel(plan_sequence.msgs)

msg = Data(plan_sequence.msgs)

# ----
# >>>>>>    Publisher
list = ValueList({"moog_stop": "0", "moog_reset": "6", "moog_enable": "15"}, selected="moog_enable")
mode_button = Button()
switch_toggle = BooleanToggle(False)
rps = Slider(27, range=0..30)

send_geometry = Button()
start_button = BooleanToggle(False)
go_to_position = Button()
shoot = Button()

# ---- group: clear trajectory and send to feeding
send_to_feeding = GhPythonScript(ros_client=ros.ros_client, feeding_pt="25280,9430,450", clear=Button(), send=Button(), next=Button())  # inputs feeding_pt: Point3d
# ---------- send_to_feeding: Python ----------
import time

from ghpythonlib.componentbase import executingcomponent as component
import roslibpy
from scriptcontext import sticky as st
from compas_fab.backends.ros.messages import ROSmsg
from compas_fab.ghpython.components import create_id
import roslibpy
from time import sleep
from planning import Target
from planning import generate_feeding_from_current_pos

clear_trajectory = 'ct_{}'.format(str(ghenv.Component.InstanceGuid))
new_trajectory = 'trajectory_{}'.format(str(ghenv.Component.InstanceGuid))

def clear_trajectory():
    service = roslibpy.Service(ros_client, '/clear_trajectory', 'std_srvs/SetBool')
    request = roslibpy.ServiceRequest({'data': True})
    st[clear_trajectory] = service.call(request,timeout = 5)
    print('Service response: {}'.format(result))
    sleep(2)

def get_current_target():
    current_pos = []
    #position x,y,z
    target = Target(position = current_pos)
    return target

def advertise_topics():
    ### designed waypoints
        topic1_name = '/design_waypoints'
        topic1_type = 'impact_printing_msgs/WaypointStates'
    ###go to position
        topic2_name = '/next_waypoint'
        topic2_type = 'std_msgs/Bool'

            
        waypoints = 'waypoints_{}'.format(str(ghenv.Component.InstanceGuid))
        next = 'next_{}'.format(str(ghenv.Component.InstanceGuid))
        
        topic1 = st.get(waypoints, None)
        topic2 = st.get(next, None)

        if ros_client and ros_client.is_connected:
            if not topic1 or topic1.ros != ros_client:
                topic1 = Topic(ros_client, topic1_name, topic1_type, reconnect_on_close=False)
                topic2 = Topic(ros_client, topic2_name, topic2_type, reconnect_on_close=False)
                topic1.advertise()
                sleep(0.2)

                st[waypoints] = topic1
                st[next] = topic2


def publish_ROS_msg(topic, message):
        msg = str(send_geometry)
        msg = ROSmsg.parse(msg, topic1_type)
        topic.publish(msg.msg)
        sleep(0.1)
        component.Message = 'Message published'


if clear_trajectory not in st:
    st[clear_trajectory]= None
if new_trajectory not in st:
    st[new_trajectory]= None

if clear:
    clear_trajectory()
    current_target = get_current_target()
    st[new_trajectory] = generate_feeding_from_current_pos(current_target, feeding_pt)
    component.Message = "Cleared the current trajectory"

#response of the service call
result = st[clear_trajectory] 
trajectory = st[new_trajectory]

#replace result as needed
if result == True and trajectory is not None:
    advertise_topics()
    if send:
        publish_ROS_msg(st[waypoints], trajectory)
        component.Message = "Sent waypoints"
    if next:
        message = json.dumps({'data': True})
        publish_ROS_msg(st[next], message)
        component.Message = "Going to position"
# ---------- end send_to_feeding ----------

# ----
msg_2 = GhPythonScript(send=send_geometry, waypoints=msg, s_m=switch_toggle)  # -> out, x
# ---------- msg_2: Python ----------
import json
import time



if send and s_m:
    x  = waypoints
    ghenv.Component.Message = "all good !!"
else:
    ghenv.Component.Message = "Switch on Shooting Belts"
#    raise ValueError('Switch on Shooting Belts')
# ---------- end msg_2 ----------

# ----
# 1. Shooting Mechanism
service_call = GhPythonScript(ros=ros.ros_client, command=list, button=mode_button)  # -> out, result; inputs command: Int32
# ---------- service_call: Python ----------
__author__ = "kchadha"
__version__ = "2022.12.05"

import time
import json

from ghpythonlib.componentbase import executingcomponent as component
from roslibpy import Topic
import roslibpy
from scriptcontext import sticky as st
from compas_fab.backends.ros.messages import ROSmsg
from compas_fab.ghpython.components import create_id
import roslibpy
from time import sleep

#client = roslibpy.Ros(host='mabi-pc', port=9090)
#client.run()
if button:
    service = roslibpy.Service(ros, '/moog_device_state', 'impact_printing_msgs/StateTransition')
    request = roslibpy.ServiceRequest({'command': command})
    print('Calling service...')
    result = service.call(request,timeout = 5)
    print('Service response: {}'.format(result))
    sleep(2)
# ---------- end service_call ----------
publish = PublishToTopic(ros_client=ros.ros_client, msg=switch_toggle, velocity=rps)  # -> topic, is_advertised
#   port ros_client: The ROS client.
#   port msg: The message to publish. It can be an instance of ROSMsg, a Python dict, or a JSON string.
#   port topic: The topic instance.
#   port is_advertised: Indicates if the topic is current advertised or not.
# ---------- publish: Python ----------
"""
Publishes messages to a ROS topic

COMPAS FAB v0.25.0
"""
import time
import json
from ghpythonlib.componentbase import executingcomponent as component
from roslibpy import Topic
from scriptcontext import sticky as st

from compas_fab.backends.ros.messages import ROSmsg
from compas_fab.ghpython.components import create_id


class ROSTopicPublish(component):
    def RunScript(self, ros_client, msg,velocity):
        topic_name = '/moog_actuator_command'
        topic_type = 'impact_printing_msgs/MoogActuatorCommand'
        if not topic_name:
            raise ValueError('Please specify the name of the topic')
        if not topic_type:
            raise ValueError('Please specify the type of the topic')

        key = create_id(self, 'topic')

        topic = st.get(key, None)

        if ros_client and ros_client.is_connected:
            if not topic or topic.ros != ros_client:
                topic = Topic(ros_client, topic_name, topic_type, reconnect_on_close=False)
                topic.advertise()
                time.sleep(0.2)

                st[key] = topic

        self.is_advertised = topic and topic.is_advertised

        if msg:
            msg = json.dumps({'velocity': velocity })
        else:
            msg = json.dumps({'velocity':0 })
        msg = ROSmsg.parse(msg, topic_type)
        topic.publish(msg.msg)
        self.Message = 'Message published'
        if self.is_advertised:
            self.Message = 'Topic advertised'

        return (topic, self.is_advertised)
# ---------- end publish ----------
panel_5 = Panel(service_call.out)
panel_6 = Panel(publish.is_advertised)
panel_7 = Panel(publish.topic)

# ----
# 2. Tool
publish_2 = PublishToTopic(ros_client=ros.ros_client, send_geometry=msg_2.x, start_button=start_button, go_to_position=go_to_position, shoot=shoot)  # -> out, topic2, is_advertised_1, is_advertised_2, is_advertised_3, is_advertised_4; inputs start_button: Boolean, go_to_position: Boolean, shoot: Boolean
#   port ros_client: The ROS client.
# ---------- publish_2: Python ----------
"""
Publishes messages to a ROS topic

COMPAS FAB v0.25.0
"""

__author__ = "kchadha"
__version__ = "2022.12.17"

import Rhino.Geometry as rg
import time
import json
from ghpythonlib.componentbase import executingcomponent as component
from roslibpy import Topic
from scriptcontext import sticky as st

from compas_fab.backends.ros.messages import ROSmsg
from compas_fab.ghpython.components import create_id



class ROSTopicPublish(component):
    def RunScript(self, ros_client, send_geometry, start_button, go_to_position, shoot):
        ### designed waypoints
        topic1_name = '/design_waypoints'
        topic1_type = 'impact_printing_msgs/WaypointStates'
        
        ###digital start button for the tool
        topic2_name = '/controllino/digital_start_button'
        topic2_type = 'std_msgs/Bool'
        
        ###go to position
        topic3_name = '/next_waypoint'
        topic3_type = 'std_msgs/Bool'
        
        ##shoot 
        topic4_name = '/controllino/digital_shoot_button'
        topic4_type = 'std_msgs/Bool'
        
#        
#        
#        if not topic1_name or topic2_name or topic3_name or topic4_name :
#            raise ValueError('Please specify the name of the topic')
#        if not topic1_type or topic2_type or topic3_type or topic4_type:
#            raise ValueError('Please specify the type of the topic')
            
        key1 = create_id(self, 'topic1')
        key2 = create_id(self, 'topic2')
        key3= create_id(self, 'topic3')
        key4= create_id(self, 'topic4')
        
        topic1 = st.get(key1, None)
        topic2 = st.get(key2, None)
        topic3 = st.get(key3, None)
        topic4 = st.get(key4, None)

        if ros_client and ros_client.is_connected:
            if not topic1 or topic1.ros != ros_client:
                topic1 = Topic(ros_client, topic1_name, topic1_type, reconnect_on_close=False)
                topic2 = Topic(ros_client, topic2_name, topic2_type, reconnect_on_close=False)
                topic3 = Topic(ros_client, topic3_name, topic3_type, reconnect_on_close=False)
                topic4 = Topic(ros_client, topic4_name, topic4_type, reconnect_on_close=False)
                topic1.advertise()
                time.sleep(0.2)

                st[key1] = topic1
                st[key2] = topic2
                st[key3] = topic3
                st[key4] = topic4

        self.is_advertised_1 = topic1 and topic1.is_advertised
        self.is_advertised_2 = topic2 and topic2.is_advertised
        self.is_advertised_3 = topic3 and topic3.is_advertised
        self.is_advertised_4 = topic4 and topic4.is_advertised
        
###designed waypoints
        if send_geometry :
            msg1 = send_geometry
#            print type(msg1)
            print msg1
            msg1 = str(send_geometry)
            msg1 = ROSmsg.parse(msg1, topic1_type)
            topic1.publish(msg1.msg)
            self.Message = 'Message published'
        else:
            if self.is_advertised_1:
                self.Message = 'Topic1 advertised'
###start digital button for the tool
        if start_button:
            msg2 = json.dumps({'data': True})
        else:
            msg2 = json.dumps({'data': False})
        msg2 = ROSmsg.parse(msg2, topic2_type)
        topic2.publish(msg2.msg)
        time.sleep(0.1)
        self.Message = 'Message published'
        if self.is_advertised_2:
            self.Message = 'Topic2 advertised'
        

###go to next waypoint
        if go_to_position:
            msg3 = json.dumps({'data': True})
            msg3 = ROSmsg.parse(msg3, topic3_type)
            topic3.publish(msg3.msg)
            time.sleep(0.1)
            self.Message = 'Message published'
        else:
            msg3 = json.dumps({'data': False})
            if self.is_advertised_3:
                self.Message = 'Topic3 advertised'
                
### Shoot !!
        if shoot:
            msg4 = json.dumps({'data': True})
            msg4 = ROSmsg.parse(msg4, topic4_type)
            topic4.publish(msg4.msg)
            time.sleep(0.1)
            self.Message = 'Message published'
        else:
            msg4 = json.dumps({'data': False})
            if self.is_advertised_4:
                self.Message = 'Topic4 advertised'

                return(topic4,self.is_advertised_4)
        return (self.is_advertised_1,self.is_advertised_2, self.is_advertised_3, self.is_advertised_4)
# ---------- end publish_2 ----------
panel_8 = Panel(publish_2.is_advertised_1)
