# Grasshopper definition 230216_Team2Design.ghx (Grasshopper 1.0.7)
# plug-ins: Pufferfish

# ---- group: General Parameters
bifurcation_thickness = Slider(125, range=0..1000)
total_height = Slider(1460, range=0..2000)
number_slider = Slider(150, range=0..10000)
number_slider_2 = Slider(1550, range=0..10000)
wall__starting_point = Point(Point(692.5615605, 4678.179786, 0))

# ---- group: Base Dimensions
base_height = Slider(150, range=0..1000)
base_length = Slider(2500, range=0..10000)
base_width = Slider(1250, range=0..10000)

# ----
lower_height = Slider(1460, range=0..2000)

# ----
# Centerline of the Wall
python = GhPythonScript(st_pt=wall__starting_point, depth=number_slider, width=number_slider_2)  # -> out, crv, mid_pt; inputs st_pt: Point3d
# ---------- python: Python ----------
import Rhino.Geometry as rg

mid_pt= st_pt.Clone()
T_mid= rg.Transform.Translation(rg.Vector3d.YAxis*(width/2))
T_mid2=rg.Transform.Translation(rg.Vector3d.XAxis*depth)
mid_pt.Transform(T_mid)
mid_pt.Transform(T_mid2)

end_pt=st_pt.Clone()
T_end= rg.Transform.Translation(rg.Vector3d.YAxis*width)
end_pt.Transform(T_end)

crv= rg.Curve.CreateInterpolatedCurve([st_pt,mid_pt,end_pt],3)

crv.Domain=rg.Interval(0,1)
# ---------- end python ----------
pt = Point(python.mid_pt)

# ---- group: CENTERLINE OF THE WALL
crv = Curve(python.crv)

# ---- group: Wall Type
list = ValueList({"Single_Layer", "Birfucated": "Bifurcated"}, selected="Birfucated")

# ---- group: Openings_Origins
pt_2 = Point(Point(911.7778402, 5493.561968, 0))  # disabled

# ---- group: Spacing
number_slider_3 = Slider(35, range=0..100)
number_slider_4 = Slider(32, range=0..100)
number_slider_5 = Slider(70, range=0..1000)

# ----
# TO DO:
# 
# - Fix list of heights for single_layer wall
# -Change the sequence for the layers of the footer
# -Shoot from specific height for bufferzone
# -Shoot from specific height for the layers above the frame
# -check the tol error
# Move the BufferZone Parameter to the opening:
# Storage
graph = GraphMapper(x0=0, x1=1, y0=0, y1=5, container_name="Gaussian", factor=0.1097403169, mean=0.4891445935, sdev=0.2359389067)
division = Division(A=number_slider_5, B=2)
number_slider_6 = Slider(2, range=1..3)
toggle = BooleanToggle(True)
toggle_2 = BooleanToggle(False)
toggle_3 = BooleanToggle(False)
toggle_4 = BooleanToggle(True)
toggle_5 = BooleanToggle(False)
addition = Addition(A=division, B=5)
graph_2 = GraphMapper(x0=0, x1=1, y0=0, y1=4, container_name="Gaussian", factor=0.1181463599, mean=0.5003812313, sdev=0.1824579835)

add_paths_from_local_dir = GhPythonScript(reload=Button())  # -> dire
# ---------- add_paths_from_local_dir: Python ----------
import os
import sys

#get current file path
path = ghenv.Component.OnPingDocument().FilePath
#get parent directory of the parent directory
parentdir = os.path.dirname(os.path.dirname(path))
#go to root folder
root = os.path.dirname(parentdir)
#get src folder which contains classes
dire = os.path.join(root,'src')

print dire
#add path to sys
sys.path.append(dire)

ghenv.Component.Message = "paths added"

from compas_rhino import unload_modules

if reload:
    unload_modules("design_team2")
    unload_modules("planning")
    
    ghenv.Component.Message = "paths updated"
# ---------- end add_paths_from_local_dir ----------
# Load classes from src
panel = Panel(add_paths_from_local_dir)

# ---- group: Total_Height / Base_Height
lowest_height = Data(base_height)

# ----
# Points
pt_3 = Point([<point referenced from the Rhino model> x1713])
number_slider_7 = Slider(2.5, range=0..10)
crv_2 = Curve(<curve referenced from the Rhino model>)
crvgraph = CurvatureGraph(Curve=crv_2, Density=Slider(6, range=0..100), Scale=Slider(121, range=0..10000))

# ----
# Wall Type / Openings
openings_size = Slider(11, range=0..100)

# ---- group: Bifurcation DIstances
opening_size = Data(openings_size)
multiplication = Multiplication(A=opening_size, B=Slider(3.3, range=0..10))
range = Range(Domain=Domain(0, 1), Steps=multiplication)
graph_3 = GraphMapper(range, x0=0, x1=1, y0=0, y1=4, container_name="Gaussian", factor=0.1181463599, mean=0.5003812313, sdev=0.1824579835)
multiplication_2 = Multiplication(A=graph_3, B=bifurcation_thickness)

# ----
python_2 = GhPythonScript(
    crv=crv,
    base_height=base_height,
    h_spacing=number_slider_5,
    v_spacing=number_slider_4,
    wall_type=list,
    lock_spacing=number_slider_3,
    origin_height=Slider(731, range=0..10000),
    opening_origin=pt_2,
    scale_factor=openings_size,
    bifurcation_thickness=bifurcation_thickness,
    bifurcation_dist=multiplication_2)  # -> out, pointsOnCrv, openings, b_list; inputs crv: Curve, opening_origin: list of Point3d, scale_factor: list, bifurcation_dist: tree
# ---------- python_2: Python ----------
import Rhino.Geometry as rg 
from ghpythonlib.treehelpers import tree_to_list as tl
from design_team2 import match_list_lengths, divide_crv, create_Openings

minor=32
major=60
tol=-2

pointsOnCrv= divide_crv(crv,h_spacing,minor,major,tol)

if len(opening_origin)==0:
    opening_origin=[rg.Point3d(crv.PointAt(0.5).X,crv.PointAt(0.5).Y,origin_height)]

opening_origin,scale_factor=match_list_lengths(opening_origin,scale_factor)
openings = create_Openings(crv,wall_type, opening_origin,h_spacing,v_spacing,lock_spacing,bifurcation_thickness, scale_factor,pointsOnCrv, base_height)


#Bifurcation
if wall_type== "Bifurcated":
    bifurcation_dist= tl(bifurcation_dist, lambda x:x[0])
    opening_origin,bifurcation_dist=match_list_lengths(opening_origin,bifurcation_dist)

    b_list= [lock_spacing]*len(pointsOnCrv)
    for i, op in enumerate(openings):
        b_index= op.b_index
        for j, b in enumerate(bifurcation_dist[i]):
            b_list[b_index-(len(bifurcation_dist[i])//2)+j]+= b
# ---------- end python_2 ----------

# ---- group: Total_Height / Number of Columns
lng = ListLength(List=python_2.pointsOnCrv)

# ---- group: Total_Height
subtraction = Subtraction(A=lng, B=1)
range_2 = Range(Domain=Domain(0, 1), Steps=subtraction)
graph_4 = GraphMapper(range_2, x0=0, x1=1, y0=0, y1=1, container_name="Gaussian", factor=1, mean=0.4969995618, sdev=0.4271832928)
total_height_2 = Data(total_height)
lowest_height_2 = Data(lower_height)
subtraction_2 = Subtraction(A=total_height_2, B=lowest_height_2)
multiplication_3 = Multiplication(A=graph_4, B=subtraction_2)

# ---- group: Total_Height / List_of Heights
addition_2 = Addition(A=lowest_height_2, B=multiplication_3, C=lowest_height)

# ----
pt_4 = Point(python_2.pointsOnCrv)
panel_2 = Panel(python_2.b_list)
python_3 = GhPythonScript(
    total_height=total_height,
    heights=addition_2,
    v_spacing=number_slider_4,
    base_height=base_height,
    pointsOnCrv=python_2.pointsOnCrv,
    wall_type=list,
    lock_spacing=number_slider_3,
    openings=python_2.openings,
    b_list=python_2.b_list,
    BufferZone=Toggle(True),
    prototype_name="Curved_Wall",
    extra_text="LV")  # -> out, shooting_points, flat_shooting_points, global_design, test; inputs heights: list, pointsOnCrv: list of Point3d, openings: list, b_list: list, BufferZone: Boolean
# ---------- python_3: Python ----------
import Rhino.Geometry as rg 
import Grasshopper as gh # https://pypi.org/project/Grasshopper-stubs/

from compas.geometry import Curve, Point
from ghpythonlib.treehelpers import list_to_tree as _tree
from ghpythonlib.treehelpers import tree_to_list as _tl

from design_team2 import GlobalDesign

total_height+= base_height
layers_num=int(total_height/v_spacing)

print layers_num
prototype_identifier = prototype_name + "_" +  extra_text

global_design= GlobalDesign.design_from_curve_with_Openings(wall_type,pointsOnCrv,openings,layers_num, v_spacing,b_list,heights,base_height, prototype_identifier, BufferZone)


#generate uid
global_design.generate_uid_for_all_parts()
shooting_points = global_design.visualize()


flat_shooting_points=[]
for s_p in (shooting_points):
    for s in s_p:
        flat_shooting_points.extend(s)

#test=[]
#for gl in global_design.layers:
#    if not gl.Bufferof==None:
#        for path in gl.paths:
#            for parts in path:
#                for part in parts:
#                    test.append(part.position)
#Convert to tree to visualize
#shooting_points = _tree(shooting_points, source = lambda x:x)#
# ---------- end python_3 ----------
ellipse = Ellipse(Plane=pt_4, Radius1=Slider(60, range=0..100), Radius2=Slider(32, range=0..100))  # -> Ellipse, Focus1, Focus2
lng_2 = ListLength(List=pt_4)
panel_3 = Panel(python_3.test)

# ---- group: Parts
data = Data(flatten(python_3.flat_shooting_points))

# ----
lng_3 = ListLength(List=data)  # -> flatten(Length)
panel_4 = Panel(lng_3)

lng_4 = ListLength(List=python_2.pointsOnCrv)
subtraction_3 = Subtraction(A=lng_4, B=6)
ellipse_2 = Ellipse(Plane=data, Radius1=Slider(60, range=0..100), Radius2=Slider(32, range=0..100))  # -> Ellipse, Focus1, Focus2
split = SplitList(List=ellipse_2.Ellipse, Index=subtraction_3)  # -> ListA, ListB

# ---- group: Openings
python_4 = GhPythonScript(openings=python_2.openings, base_height=base_height)  # -> out, origin, frame_size, port, tip, tip_height, port_2, bottom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; inputs openings: list
# ---------- python_4: Python ----------
import Rhino.Geometry as rg

tip=[x.Tip() for x in openings]
tip_height=[str(int(t.Z-base_height)) + " // " + str(int(t.Z)) for t in tip]

bottom=[x.Bottom_Tip() for x in openings]
bottom_height=[str(int(b.Z-base_height)) + " // " + str(int(b.Z)) for b in bottom]

origin= [x.origin for x in openings]
vis_line=[x.visline for x in openings]
frame_size= ["size:" + str(x.FrameSize()) for x in openings]
brep= [x.brep for x in openings]
outline = [x.outline for x in openings]

bc= [x.buffer for x in openings]
# ---------- end python_4 ----------
geo = Geometry(python_4.brep)
crv_3 = Curve(python_4.outline)
crv_4 = Curve(python_4.vis_line)
tag = TextTag(Location=python_4.origin, Text=python_4.frame_size, Colour=RGB(255, 255, 255))
tag_2 = TextTag(Location=[python_4.tip, python_4.bottom], Text=[python_4.tip_height, python_4.bottom_height], Colour=RGB(255, 255, 255))
panel_5 = Panel(python_4.frame_size)

# ----
# Number of Bullet    :
# 
# Frame                      :
# 
# Tip Height               :
# 
# Bottom Tip Height  :
panel_6 = Panel(panel_5)
panel_7 = Panel(python_4.tip_height)
panel_8 = Panel(python_4.bottom_height)
panel_9 = Panel(panel_4)

# ---- group: Visualize Frame
frame_depth = Slider(200, range=0..500)  # disabled
slat_depth = Slider(25, range=0..100)  # disabled
slat_width = Slider(25, range=0..100)  # disabled
cluster = Cluster(crv=python_4.outline, x=slat_width, F=slat_depth, A_2=frame_depth, A=slat_depth)  # disabled
swatch = ColourSwatch(SwatchColor=RGB(207, 207, 207))  # disabled

# ---- group: Visualize Bullets
division_2 = Division(A=number_slider_5, B=2)
sph = Sphere(Base=data, Radius=division_2)
swatch_2 = ColourSwatch(SwatchColor=RGB(130, 130, 130))
swatch_3 = ColourSwatch(SwatchColor=RGB(207, 207, 207))
scale_nu = ScaleNU(Geometry=sph, Plane=data, ScaleX=Slider(1.7, range=0..10), ScaleY=Slider(0.9, range=0..1), ScaleZ=1)  # -> Geometry, Transform

# ---- group: Check the sequence
number_slider_8 = Slider(750, range=0..750)
# Visualization
python_5 = GhPythonScript(points=data, index=Slider(1478, range=0..10000))  # -> out, p, a; inputs points: list of Point3d, index: Int32
# ---------- python_5: Python ----------
import Rhino.Geometry as rg

p=[]
for i in range(index):
    p.append(points[i])

a= rg.Sphere(points[index], 25)
# ---------- end python_5 ----------
listdexs = ListIndices(List=python_5.p)
geo_2 = Geometry(python_5.a)

# ---- group: Footprint
data_2 = Data(split.ListA)

# ----
pt_5 = Point(python_4.origin)

cluster_2 = Cluster_2(G=data_2, X=base_width, Y=base_length, x=base_height, A=base_width, A_2=base_length)

division_3 = Division(A=base_width, B=2)
area = Area(Geometry=cluster_2)  # -> Area, Centroid
X = UnitX(Factor=division_3)
move = Move(Geometry=area.Centroid, Motion=X)  # -> Geometry, Transform
tag_3 = TextTag(Location=move.Geometry, Text=lng_3, Colour=RGB(255, 255, 255))

geo_3 = Geometry(python_4.bc)

# ----
# Sequence
tag_4 = TextTag(Location=python_5.p, Text=listdexs)
pline = PolyLine(Vertices=python_5.p, Closed=False)

# ----
# Base
preview = CustomPreview(Geometry=cluster_2, Material=ColourSwatch(SwatchColor=RGBA(207, 207, 207, 91)))

# ----
# Bullets
preview_2 = CustomPreview(Geometry=scale_nu.Geometry, Material=swatch_2)

# ----
# Frames
preview_3 = CustomPreview(Geometry=cluster, Material=swatch)  # disabled

# ==== cluster Cluster
crv = ClusterInput()
A = ClusterInput()
crv_2 = Curve(crv)
multiplication = Multiplication(A=A, B=2)
A_2 = ClusterInput()
explode = Explode(Curve=crv_2, Recursive=True)  # -> Segments, Vertices
F = ClusterInput()
division = Division(A=A_2, B=multiplication)
dispatch = Dispatch(List=explode.Segments, DispatchPattern=[True, False])  # -> ListA, ListB
X = UnitX(Factor=F)
round = Round(Number=division)  # -> Nearest, Floor, Ceiling
extr = Extrude(Base=dispatch.ListA, Direction=X)
neg = Negative(Value=X)
extr_2 = Extrude(Base=dispatch.ListB, Direction=neg)
x = ClusterInput()
flip = Flip(Surface=extr_2)  # -> Surface, Result
neg_2 = Negative(Value=x)
multiplication_2 = Multiplication(A=X, B=2)
multiplication_3 = Multiplication(A=X, B=3)
offsrf = OffsetSurface(Surface=[flip.Surface, extr], Distance=neg_2, BothSides=0, CreateSolid=True)
neg_3 = Negative(Value=multiplication_3)
arrlinear = LinearArray(Geometry=offsrf, Direction=multiplication_2, Count=round.Nearest)  # -> Geometry, Transform
move = Move(Geometry=arrlinear.Geometry, Motion=neg_3)  # -> Geometry, Transform
G = ClusterOutput(move.Geometry)

# ==== cluster Cluster_2
A = ClusterInput()
A_2 = ClusterInput()
G = ClusterInput()
division = Division(A=A, B=2)
division_2 = Division(A=A_2, B=2)
brec = BoundingRectangle(Geometry=G, Plane=PlaneXY(0, 0, 0), Axis=0, Slide=0, Union=True)  # -> Bounding, DimensionX, DimensionY
neg = Negative(Value=division)
neg_2 = Negative(Value=division_2)
X = ClusterInput()
Y = ClusterInput()
area = Area(Geometry=brec.Bounding)  # -> Area, Centroid
X_2 = UnitX(Factor=neg)
Y_2 = UnitY(Factor=neg_2)
rectangle = Rectangle(Plane=area.Centroid, XSize=X, YSize=Y, Radius=0)  # -> Rectangle, Length
addition = Addition(A=X_2, B=Y_2)
x = ClusterInput()
neg_3 = Negative(Value=x)
move = Move(Geometry=rectangle.Rectangle, Motion=addition)  # -> Geometry, Transform
Z = UnitZ(Factor=neg_3)
extr = Extrude(Base=move.Geometry, Direction=Z)
cap = CapHoles(Brep=extr)
B = ClusterOutput(cap)
