# Grasshopper definition 230228_Gantry_ProductionFile_Team2.ghx (Grasshopper 1.0.7)
# plug-ins: Pufferfish

# ---- group: General Parameters
bifurcation_thickness = Slider(249, range=0..1000)
total_height = Slider(1460, range=0..2000)
number_slider = Slider(0, range=0..10000)
number_slider_2 = Slider(1664, range=0..10000)
wall__starting_point = Point(Point(692.5615605, 4678.179786, 0))

# ---- group: Base Dimensions
base_height = Slider(150, range=0..1000)
base_length = Slider(2500, range=0..10000)
base_width = Slider(1250, range=0..10000)

# ----
lower_height = Slider(1460, range=0..2000)

# ----
# Centerline of the Wall
python = GhPythonScript(st_pt=wall__starting_point, depth=number_slider, width=number_slider_2)  # -> out, crv, mid_pt; inputs st_pt: Point3d
# ---------- python: Python ----------
import Rhino.Geometry as rg

mid_pt= st_pt.Clone()
T_mid= rg.Transform.Translation(rg.Vector3d.YAxis*(width/2))
T_mid2=rg.Transform.Translation(rg.Vector3d.XAxis*depth)
mid_pt.Transform(T_mid)
mid_pt.Transform(T_mid2)

end_pt=st_pt.Clone()
T_end= rg.Transform.Translation(rg.Vector3d.YAxis*width)
end_pt.Transform(T_end)

crv= rg.Curve.CreateInterpolatedCurve([st_pt,mid_pt,end_pt],3)

crv.Domain=rg.Interval(0,1)
# ---------- end python ----------
pt = Point(python.mid_pt)

# ---- group: CENTERLINE OF THE WALL
crv = Curve(python.crv)

# ----
panel = Panel("377")

# ---- group: Wall Type
list = ValueList({"Single_Layer", "Birfucated": "Bifurcated", "Branched"}, selected="Branched")

# ---- group: Openings_Origins
pt_2 = Point(<point referenced from the Rhino model>)  # disabled

# ---- group: Spacing
number_slider_3 = Slider(35, range=0..100)
number_slider_4 = Slider(35, range=0..100)
number_slider_5 = Slider(64, range=0..1000)

# ----
# TO DO:
# 
# - Fix list of heights for single_layer wall
# -check the tol error
# Move the BufferZone Parameter to the opening:
# Storage
graph = GraphMapper(x0=0, x1=1, y0=0, y1=5, container_name="Gaussian", factor=0.1097403169, mean=0.4891445935, sdev=0.2359389067)
division = Division(A=number_slider_5, B=2)
number_slider_6 = Slider(2, range=1..3)
toggle = BooleanToggle(True)
toggle_2 = BooleanToggle(False)
toggle_3 = BooleanToggle(False)
toggle_4 = BooleanToggle(True)
toggle_5 = BooleanToggle(False)
addition = Addition(A=division, B=5)
graph_2 = GraphMapper(x0=0, x1=1, y0=0, y1=4, container_name="Gaussian", factor=0.1181463599, mean=0.5003812313, sdev=0.1824579835)

number_slider_7 = Slider(35, range=0..100)

add_paths_from_local_dir = GhPythonScript(reload=Button())  # -> dire
# ---------- add_paths_from_local_dir: Python ----------
import os
import sys

#get current file path
path = ghenv.Component.OnPingDocument().FilePath
#get parent directory of the parent directory
parentdir = os.path.dirname(os.path.dirname(path))
#go to root folder
root = os.path.dirname(parentdir)
#get src folder which contains classes
dire = os.path.join(root,'src')

print dire
#add path to sys
sys.path.append(dire)

ghenv.Component.Message = "paths added"

from compas_rhino import unload_modules

if reload:
    unload_modules("design_team2")
    unload_modules("planning")
    
    ghenv.Component.Message = "paths updated"
# ---------- end add_paths_from_local_dir ----------
# Load classes from src
panel_2 = Panel(add_paths_from_local_dir)

# ---- group: Total_Height / Base_Height
lowest_height = Data(base_height)

# ----
number_slider_8 = Slider(35, range=0..100)
panel_3 = Panel("Day 1: 752")
division_2 = Division(A=number_slider_5, B=2)
ip_of_the_nuc = Panel("192.168.0.112")
pt_3 = Point([Point(19979.5, 9432.39, 2100), Point(19967.90239, 9950.659608, 402.69), Point(19962.01793, 9883.955008, 402.69), Point(19936.02531, 9823.375433, 402.69), Point(19884.26654, 9781.010736, 402.69), Point(19833.9259, 9737.179411, 402.69)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])  # disabled
ros = ROSConnect(ip=ip_of_the_nuc, connect=Toggle(False))  # -> ros_client, is_connected; inputs port: Int32, connect: Boolean
#   port ip: The ip address ROS. Defaults to 127.0.0.1.
#   port port: The port of ROS. Defaults to 9090.
#   port connect: If True, connects to ROS. If False, disconnects from ROS. Defaults to False.
#   port ros_client: The ROS client.
#   port is_connected: True if connection established.
# ---------- ros: Python ----------
"""
Connect or disconnect to ROS.

COMPAS FAB v0.25.0
"""
from ghpythonlib.componentbase import executingcomponent as component
from scriptcontext import sticky as st

from compas_fab.backends import RosClient
from compas_fab.ghpython.components import create_id


class ROSConnect(component):
    def RunScript(self, ip, port, connect):
        ros_client = None

        ip = ip or '127.0.0.1'
        port = port or 9090

        key = create_id(self, 'ros_client')
        ros_client = st.get(key, None)

        if ros_client:
            st[key].close()
        if connect:
            st[key] = RosClient(ip, port)
            st[key].run(5)
        if not connect:
            ros_client.terminate()

#        if terminate:
#            ros_client.terminate()

        ros_client = st.get(key, None)
        is_connected = ros_client.is_connected if ros_client else False
        return (ros_client, is_connected)
# ---------- end ros ----------
panel_4 = Panel("00-00-05")
panel_5 = Panel(ros.is_connected)

# ----
# >>>>>>    Publisher
list_2 = ValueList({"moog_stop": "0", "moog_reset": "6", "moog_enable": "15"}, selected="moog_enable")
mode_button = Button()
switch_toggle = BooleanToggle(False)
rps = Slider(27, range=0..30)

send_geometry = Button()
start_button = BooleanToggle(False)
go_to_position = Button()
shoot = Button()

# ---- group: clear trajectory and send to feeding
send_to_feeding = GhPythonScript(ros_client=ros.ros_client, feeding_pt="25280,9430,450", clear=Button(), send=Button(), next=Button())  # inputs feeding_pt: Point3d
# ---------- send_to_feeding: Python ----------
import time

from ghpythonlib.componentbase import executingcomponent as component
import roslibpy
from scriptcontext import sticky as st
from compas_fab.backends.ros.messages import ROSmsg
from compas_fab.ghpython.components import create_id
import roslibpy
from time import sleep
from planning import Target
from planning import generate_feeding_from_current_pos

clear_trajectory = 'ct_{}'.format(str(ghenv.Component.InstanceGuid))
new_trajectory = 'trajectory_{}'.format(str(ghenv.Component.InstanceGuid))

def clear_trajectory():
    service = roslibpy.Service(ros_client, '/clear_trajectory', 'std_srvs/SetBool')
    request = roslibpy.ServiceRequest({'data': True})
    st[clear_trajectory] = service.call(request,timeout = 5)
    print('Service response: {}'.format(result))
    sleep(2)

def get_current_target():
    current_pos = []
    #position x,y,z
    target = Target(position = current_pos)
    return target

def advertise_topics():
    ### designed waypoints
        topic1_name = '/design_waypoints'
        topic1_type = 'impact_printing_msgs/WaypointStates'
    ###go to position
        topic2_name = '/next_waypoint'
        topic2_type = 'std_msgs/Bool'

            
        waypoints = 'waypoints_{}'.format(str(ghenv.Component.InstanceGuid))
        next = 'next_{}'.format(str(ghenv.Component.InstanceGuid))
        
        topic1 = st.get(waypoints, None)
        topic2 = st.get(next, None)

        if ros_client and ros_client.is_connected:
            if not topic1 or topic1.ros != ros_client:
                topic1 = Topic(ros_client, topic1_name, topic1_type, reconnect_on_close=False)
                topic2 = Topic(ros_client, topic2_name, topic2_type, reconnect_on_close=False)
                topic1.advertise()
                sleep(0.2)

                st[waypoints] = topic1
                st[next] = topic2


def publish_ROS_msg(topic, message):
        msg = str(send_geometry)
        msg = ROSmsg.parse(msg, topic1_type)
        topic.publish(msg.msg)
        sleep(0.1)
        component.Message = 'Message published'


if clear_trajectory not in st:
    st[clear_trajectory]= None
if new_trajectory not in st:
    st[new_trajectory]= None

if clear:
    clear_trajectory()
    current_target = get_current_target()
    st[new_trajectory] = generate_feeding_from_current_pos(current_target, feeding_pt)
    component.Message = "Cleared the current trajectory"

#response of the service call
result = st[clear_trajectory] 
trajectory = st[new_trajectory]

#replace result as needed
if result == True and trajectory is not None:
    advertise_topics()
    if send:
        publish_ROS_msg(st[waypoints], trajectory)
        component.Message = "Sent waypoints"
    if next:
        message = json.dumps({'data': True})
        publish_ROS_msg(st[next], message)
        component.Message = "Going to position"
# ---------- end send_to_feeding ----------

# ----
# 1. Shooting Mechanism
service_call = GhPythonScript(ros=ros.ros_client, command=list_2, button=mode_button)  # -> out, result; inputs command: Int32
# ---------- service_call: Python ----------
__author__ = "kchadha"
__version__ = "2022.12.05"

import time
import json

from ghpythonlib.componentbase import executingcomponent as component
from roslibpy import Topic
import roslibpy
from scriptcontext import sticky as st
from compas_fab.backends.ros.messages import ROSmsg
from compas_fab.ghpython.components import create_id
import roslibpy
from time import sleep

#client = roslibpy.Ros(host='mabi-pc', port=9090)
#client.run()
if button:
    service = roslibpy.Service(ros, '/moog_device_state', 'impact_printing_msgs/StateTransition')
    request = roslibpy.ServiceRequest({'command': command})
    print('Calling service...')
    result = service.call(request,timeout = 5)
    print('Service response: {}'.format(result))
    sleep(2)
# ---------- end service_call ----------
publish = PublishToTopic(ros_client=ros.ros_client, msg=switch_toggle, velocity=rps)  # -> topic, is_advertised
#   port ros_client: The ROS client.
#   port msg: The message to publish. It can be an instance of ROSMsg, a Python dict, or a JSON string.
#   port topic: The topic instance.
#   port is_advertised: Indicates if the topic is current advertised or not.
# ---------- publish: Python ----------
"""
Publishes messages to a ROS topic

COMPAS FAB v0.25.0
"""
import time
import json
from ghpythonlib.componentbase import executingcomponent as component
from roslibpy import Topic
from scriptcontext import sticky as st

from compas_fab.backends.ros.messages import ROSmsg
from compas_fab.ghpython.components import create_id


class ROSTopicPublish(component):
    def RunScript(self, ros_client, msg,velocity):
        topic_name = '/moog_actuator_command'
        topic_type = 'impact_printing_msgs/MoogActuatorCommand'
        if not topic_name:
            raise ValueError('Please specify the name of the topic')
        if not topic_type:
            raise ValueError('Please specify the type of the topic')

        key = create_id(self, 'topic')

        topic = st.get(key, None)

        if ros_client and ros_client.is_connected:
            if not topic or topic.ros != ros_client:
                topic = Topic(ros_client, topic_name, topic_type, reconnect_on_close=False)
                topic.advertise()
                time.sleep(0.2)

                st[key] = topic

        self.is_advertised = topic and topic.is_advertised

        if msg:
            msg = json.dumps({'velocity': velocity })
        else:
            msg = json.dumps({'velocity':0 })
        msg = ROSmsg.parse(msg, topic_type)
        topic.publish(msg.msg)
        self.Message = 'Message published'
        if self.is_advertised:
            self.Message = 'Topic advertised'

        return (topic, self.is_advertised)
# ---------- end publish ----------
panel_6 = Panel(service_call.out)
panel_7 = Panel(publish.is_advertised)
panel_8 = Panel(publish.topic)

neg = Negative(Value=Slider(180, range=0..1000))
X = UnitX(Factor=neg)
number_slider_9 = Slider(1000, range=0..1000)
Z = UnitZ(Factor=Slider(5000, range=0..10000))

# ----
# Wall Type / Openings
openings_size = Slider(11, range=0..100)

# ---- group: Bifurcation DIstances
opening_size = Data(openings_size)
multiplication = Multiplication(A=opening_size, B=Slider(4, range=0..10))
range = Range(Domain=Domain(0, 1), Steps=multiplication)
graph_3 = GraphMapper(range, x0=0, x1=1, y0=0, y1=4, container_name="Gaussian", factor=0.1537245512, mean=0.5003812313, sdev=0.2287859619)
multiplication_2 = Multiplication(A=graph_3, B=bifurcation_thickness)

# ----
python_2 = GhPythonScript(
    crv=crv,
    base_height=base_height,
    h_spacing=number_slider_5,
    v_spacing=number_slider_4,
    wall_type=list,
    lock_spacing=number_slider_3,
    origin_height=Slider(730, range=0..2000),
    opening_origin=pt_2,
    scale_factor=openings_size,
    bifurcation_thickness=bifurcation_thickness,
    bifurcation_dist=multiplication_2)  # -> out, pointsOnCrv, openings, b_list; inputs crv: Curve, opening_origin: list of Point3d, scale_factor: list, bifurcation_dist: tree
# ---------- python_2: Python ----------
import Rhino.Geometry as rg 
from ghpythonlib.treehelpers import tree_to_list as tl
from design_team2 import match_list_lengths, divide_crv, create_Openings

minor=h_spacing/2
major=60
tol=-2

pointsOnCrv= divide_crv(crv,h_spacing,minor,major,tol)

bifurcation_dist= tl(bifurcation_dist, lambda x:x[0])
bifur_dist= [max(b_d) + lock_spacing for b_d in bifurcation_dist]

if len(opening_origin)==0:
    opening_origin=[rg.Point3d(crv.PointAt(0.5).X,crv.PointAt(0.5).Y,origin_height)]

opening_origin,scale_factor=match_list_lengths(opening_origin,scale_factor)
openings = create_Openings(crv,wall_type, opening_origin,h_spacing,v_spacing,lock_spacing,bifur_dist, scale_factor,pointsOnCrv, base_height)


#Bifurcation
if wall_type== "Bifurcated":
    opening_origin,bifurcation_dist=match_list_lengths(opening_origin,bifurcation_dist)
    b_list= [lock_spacing]*len(pointsOnCrv)
    for i, op in enumerate(openings):
        b_index= op.b_index
        for j, b in enumerate(bifurcation_dist[i]):
            b_list[b_index-(len(bifurcation_dist[i])//2)+j]+= b

#Branching
if wall_type== "Branched":
    opening_origin,bifurcation_dist=match_list_lengths(opening_origin,bifurcation_dist)
    b_list= [0]*len(pointsOnCrv)
    for i, op in enumerate(openings):
        b_index= op.b_index
        for j, b in enumerate(bifurcation_dist[i]):
            b_list[b_index-(len(bifurcation_dist[i])//2)+j]+= (b+lock_spacing)
# ---------- end python_2 ----------

# ---- group: Total_Height / Number of Columns
lng = ListLength(List=python_2.pointsOnCrv)

# ---- group: Total_Height
subtraction = Subtraction(A=lng, B=1)
range_2 = Range(Domain=Domain(0, 1), Steps=subtraction)
graph_4 = GraphMapper(range_2, x0=0, x1=1, y0=0, y1=1, container_name="Gaussian", factor=1, mean=0.4969995618, sdev=0.4271832928)
total_height_2 = Data(total_height)
lowest_height_2 = Data(lower_height)
subtraction_2 = Subtraction(A=total_height_2, B=lowest_height_2)
multiplication_3 = Multiplication(A=graph_4, B=subtraction_2)

# ---- group: Total_Height / List_of Heights
addition_2 = Addition(A=lowest_height_2, B=multiplication_3, C=lowest_height)

# ----
pt_4 = Point(python_2.pointsOnCrv)
python_3 = GhPythonScript(
    total_height=total_height,
    heights=addition_2,
    v_spacing=number_slider_4,
    base_height=base_height,
    pointsOnCrv=python_2.pointsOnCrv,
    wall_type=list,
    lock_spacing=number_slider_3,
    openings=python_2.openings,
    b_list=python_2.b_list,
    BufferZone=Toggle(False),
    prototype_name="Curved_Wall",
    extra_text="LV")  # -> out, shooting_points, flat_shooting_points, global_design, buffer_points; inputs heights: list, pointsOnCrv: list of Point3d, openings: list, b_list: list, BufferZone: Boolean
# ---------- python_3: Python ----------
import Rhino.Geometry as rg 
import Grasshopper as gh # https://pypi.org/project/Grasshopper-stubs/

from compas.geometry import Curve, Point
from ghpythonlib.treehelpers import list_to_tree as _tree
from ghpythonlib.treehelpers import tree_to_list as _tl

from design_team2 import GlobalDesign

open_lay=int((openings[0].origin.Z- base_height)/v_spacing)
footer_layer = int(open_lay-(openings[0].factor+2)-1) # 2 are the bufferzone layers

total_height+= base_height
layers_num=int(total_height/v_spacing)

prototype_identifier = prototype_name + "_" +  extra_text

global_design= GlobalDesign.design_from_curve_with_Openings(wall_type,pointsOnCrv,openings,layers_num, v_spacing,b_list,heights,base_height,footer_layer, prototype_identifier, BufferZone)


#generate uid
global_design.generate_uid_for_all_parts()
shooting_points = global_design.visualize()


flat_shooting_points=[]
for s_p in (shooting_points):
    for s in s_p:
        flat_shooting_points.extend(s)

buffer_points=[]
for gl in global_design.layers:
    if not gl.Bufferof==None:
        for path in gl.paths:
            for part in path.parts:
                buffer_points.append(part.position)

#Convert to tree to visualize
#shooting_points = _tree(shooting_points, source = lambda x:x)#
# ---------- end python_3 ----------
ellipse = Ellipse(Plane=pt_4, Radius1=Slider(60, range=0..100), Radius2=Slider(32, range=0..100))  # -> Ellipse, Focus1, Focus2
lng_2 = ListLength(List=pt_4)
lng_3 = ListLength(List=python_2.pointsOnCrv)

# ---- group: Parts
data = Data(flatten(python_3.flat_shooting_points))

# ----
# Points in Buffer Zone
lng_4 = ListLength(List=data)  # -> flatten(Length)
# Points
panel_9 = Panel(lng_4)

pt_5 = Point(python_3.buffer_points)
subtraction_3 = Subtraction(A=lng_3, B=Slider(3, range=0..10))
ellipse_2 = Ellipse(Plane=data, Radius1=Slider(60, range=0..100), Radius2=division_2)  # -> Ellipse, Focus1, Focus2
split = SplitList(List=ellipse_2.Ellipse, Index=subtraction_3)  # -> ListA, ListB

# ---- group: Openings
python_4 = GhPythonScript(openings=python_2.openings, base_height=base_height)  # -> out, origin, frame_size, port, tip, tip_height, port_2, bottom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; inputs openings: list
# ---------- python_4: Python ----------
import Rhino.Geometry as rg

tip=[x.Tip() for x in openings]
tip_height=[str(int(t.Z-base_height)) + " // " + str(int(t.Z)) for t in tip]

bottom=[x.Bottom_Tip() for x in openings]
bottom_height=[str(int(b.Z-base_height)) + " // " + str(int(b.Z)) for b in bottom]

origin= [x.origin for x in openings]
vis_line=[x.visline for x in openings]
frame_size= ["size:" + str(x.FrameSize()) for x in openings]
brep= [x.brep for x in openings]
outline = [x.outline for x in openings]

buffer_brep= [x.buffer for x in openings]
# ---------- end python_4 ----------
geo = Geometry(python_4.brep)
crv_2 = Curve(python_4.outline)
crv_3 = Curve(python_4.vis_line)
tag = TextTag(Location=python_4.origin, Text=python_4.frame_size, Colour=RGB(255, 255, 255))
tag_2 = TextTag(Location=[python_4.tip, python_4.bottom], Text=[python_4.tip_height, python_4.bottom_height], Colour=RGB(255, 255, 255))
panel_10 = Panel(python_4.frame_size)

# ----
# Number of Bullet    :
# 
# Frame                      :
# 
# Tip Height               :
# 
# Bottom Tip Height  :
panel_11 = Panel(panel_10)
panel_12 = Panel(python_4.tip_height)
panel_13 = Panel(python_4.bottom_height)
panel_14 = Panel(panel_9)

# ---- group: Visualize Bullets
division_3 = Division(A=number_slider_5, B=2)
sph = Sphere(Base=data, Radius=division_3)
swatch = ColourSwatch(SwatchColor=RGB(130, 130, 130))
swatch_2 = ColourSwatch(SwatchColor=RGB(207, 207, 207))
scale_nu = ScaleNU(Geometry=sph, Plane=data, ScaleX=Slider(1.9, range=0..10), ScaleY=Slider(0.9, range=0..1), ScaleZ=1)  # -> Geometry, Transform

# ---- group: Check the sequence
number_slider_10 = Slider(750, range=0..750)
number_slider_11 = Slider(83, range=0..10000)
# Visualization
python_5 = GhPythonScript(points=data, index=Slider(600, range=0..10000))  # -> out, p, a; inputs points: list of Point3d, index: Int32
# ---------- python_5: Python ----------
import Rhino.Geometry as rg

p=[]
for i in range(index):
    p.append(points[i])

a= rg.Sphere(points[index], 25)
# ---------- end python_5 ----------
listdexs = ListIndices(List=python_5.p)
geo_2 = Geometry(python_5.a)

# ---- group: Footprint
data_2 = Data(split.ListA)

# ----
pt_6 = Point(python_4.origin)

cluster = Cluster_2(G=data_2, X=base_width, Y=base_length, x=base_height, A=base_width, A_2=base_length)

geo_3 = Geometry(python_4.buffer_brep)

debrep = DeconstructBrep(Brep=geo)  # -> Faces, Edges, Vertices
number_slider_12 = Slider(120, range=0..1000)
number_slider_13 = Slider(100, range=0..100)
item = ListItem(List=debrep.Faces, Index=-1, Wrap=True)
wires = BrepWireframe(Brep=item, Density=-1)
neg_2 = Negative(Value=number_slider_12)
join = JoinCurves(Curves=wires, Preserve=False)
X_2 = UnitX(Factor=neg_2)
move = Move(Geometry=join, Motion=X_2)  # -> Geometry, Transform

X_3 = UnitX(Factor=python_2.b_list)
bbox = BoundingBox(Content=join, Plane=PlaneXY(0, 0, 0))  # -> Box, Box_2
move_2 = Move(Geometry=python_2.pointsOnCrv, Motion=X_3)  # -> Geometry, Transform
debrep_2 = DeconstructBrep(Brep=bbox.Box)  # -> Faces, Edges, Vertices
cull_i = CullIndex(List=move_2.Geometry, Indices=[0, 1, 2, 3, -4, -3, -2, -1], Wrap=True)
item_2 = ListItem(List=debrep_2.Edges, Index=0, Wrap=True)
projecta = ProjectAlong(Geometry=item_2, Plane=PlaneXY(0, 0, 0), Direction=Vector(0, 0, -1))  # -> Geometry, Transform
intcrv = Interpolate(Vertices=cull_i, Degree=3, Periodic=False, KnotStyle=1)  # -> reparameterize(Curve), Length, Domain
move_3 = Move(Geometry=projecta.Geometry, Motion=X)  # -> Geometry, Transform
midpt = CurveMiddle(Curve=intcrv.Curve)
clx = CurveLine(Curve=intcrv.Curve, Line=move_3.Geometry)  # -> flatten(Points), Params, Count
ins = InsertItems(List=clx.Points, Item=midpt, Indices=1, Wrap=True)
pline = PolyLine(Vertices=flatten(ins), Closed=False)
extr = Extrude(Base=pline, Direction=Z)

# ---- group: Visualize Frame
frame_depth = Slider(200, range=0..500)  # disabled
slat_depth = Slider(25, range=0..100)  # disabled
slat_width = Slider(25, range=0..100)  # disabled
cluster_2 = Cluster(crv=[python_4.outline, move.Geometry], x=slat_width, F=slat_depth, A_2=frame_depth, A=slat_depth)  # disabled
swatch_3 = ColourSwatch(SwatchColor=RGB(207, 207, 207))  # disabled

# ----
debrep_3 = DeconstructBrep(Brep=geo)  # -> Faces, Edges, Vertices
subtraction_4 = Subtraction(A=number_slider_12, B=100)
neg_3 = Negative(Value=subtraction_4)
item_3 = ListItem(List=debrep_3.Faces, Index=0, Wrap=True)
X_4 = UnitX(Factor=neg_3)
wires_2 = BrepWireframe(Brep=item_3, Density=-1)
move_4 = Move(Geometry=join, Motion=X_4)  # -> Geometry, Transform
join_2 = JoinCurves(Curves=wires_2, Preserve=False)
flip = FlipCurve(Curve=move_4.Geometry)  # -> Curve, Flag
neg_4 = Negative(Value=Slider(65, range=0..100))
relay = Relay([flip.Curve, join_2])
offset = OffsetCurve(Curve=relay, Distance=neg_4, Corners=1)  # -> flatten(Curve)
split_2 = SplitBrep(Brep=relay, Cutter=offset)
loft = Loft(Curves=offset, Options={Adjust=False, Closed=False, LoftEnds=0, LoftSimp=0, LoftType=0, Rebuild=10, Refit=0.01})
item_4 = ListItem(List=split_2, Index=-1, Wrap=True)  # -> flatten(Item)
join_3 = BrepJoin(Breps=[item_4, loft])  # -> Breps, Closed
offsrf = OffsetSurface(Surface=join_3.Breps, Distance=Slider(2.5, range=0..10), BothSides=0, CreateSolid=True)

# ----
# Desk Crit 27.02.2023
# Bullets
# Frames
# Base
# Cover
data_3 = Data(scale_nu.Geometry)
data_4 = Data(cluster_2)
data_5 = Data(cluster)
data_6 = Data(offsrf)  # disabled

preview = CustomPreview(Geometry=data_4, Material=ColourSwatch(SwatchColor=RGB(105, 105, 105)))
preview_2 = CustomPreview(Geometry=data_6, Material=ColourSwatch(SwatchColor=RGB(242, 242, 242)))
preview_3 = CustomPreview(Geometry=data_3, Material=ColourSwatch(SwatchColor=RGB(176, 176, 176)))
preview_4 = CustomPreview(Geometry=data_5, Material=ColourSwatch(SwatchColor=RGB(117, 117, 117)))

# ----
# Sequence
tag_3 = TextTag(Location=python_5.p, Text=listdexs)
pline_2 = PolyLine(Vertices=python_5.p, Closed=False)

# ----
# Base
preview_5 = CustomPreview(Geometry=cluster, Material=ColourSwatch(SwatchColor=RGB(207, 207, 207)))

# ----
# Bullets
preview_6 = CustomPreview(Geometry=scale_nu.Geometry, Material=swatch)

# ----
# Frames
preview_7 = CustomPreview(Geometry=cluster_2, Material=swatch_3)  # disabled

# ----
# Number of Points
division_4 = Division(A=base_width, B=2)
X_5 = UnitX(Factor=division_4)
area = Area(Geometry=cluster)  # -> Area, Centroid
move_5 = Move(Geometry=area.Centroid, Motion=X_5)  # -> Geometry, Transform
tag_4 = TextTag(Location=move_5.Geometry, Text=lng_4, Colour=RGB(255, 255, 255))

plan_sequence = GhPythonScript(
    design=python_3.global_design,
    toolpath_volume=Slider(50, range=0..100),
    feeding_pt="25280,9430,450",
    n=Slider(17, range=0..100))  # -> sequencer, points, tool_curve, msgs; inputs toolpath_volume: Int32, feeding_pt: Point3d, n: Int32
# ---------- plan_sequence: Python ----------
from planning import ConstructionSequencer


sequencer = ConstructionSequencer(design, toolpath_volume)
sequencer.generate_toolpaths_continuous(start_uid)
#print sequencer.targets_flat
toolpath = sequencer.toolpaths[n]
toolpath.add_safety_points()
toolpath.create_feeding_trajectory(feeding_pt)


points, tool_curve = toolpath.visualize_pts()
msgs_dict, msgs = toolpath.export_toolpath_to_ROS()
# ---------- end plan_sequence ----------
panel_15 = Panel(plan_sequence.msgs)

msg = Data(plan_sequence.msgs)

msg_2 = GhPythonScript(send=send_geometry, waypoints=msg, s_m=switch_toggle)  # -> out, x
# ---------- msg_2: Python ----------
import json
import time



if send and s_m:
    x  = waypoints
    ghenv.Component.Message = "all good !!"
else:
    ghenv.Component.Message = "Switch on Shooting Belts"
#    raise ValueError('Switch on Shooting Belts')
# ---------- end msg_2 ----------
# 2. Tool
publish_2 = PublishToTopic(ros_client=ros.ros_client, send_geometry=msg_2.x, start_button=start_button, go_to_position=go_to_position, shoot=shoot)  # -> out, topic2, is_advertised_1, is_advertised_2, is_advertised_3, is_advertised_4; inputs start_button: Boolean, go_to_position: Boolean, shoot: Boolean
#   port ros_client: The ROS client.
# ---------- publish_2: Python ----------
"""
Publishes messages to a ROS topic

COMPAS FAB v0.25.0
"""

__author__ = "kchadha"
__version__ = "2022.12.17"

import Rhino.Geometry as rg
import time
import json
from ghpythonlib.componentbase import executingcomponent as component
from roslibpy import Topic
from scriptcontext import sticky as st

from compas_fab.backends.ros.messages import ROSmsg
from compas_fab.ghpython.components import create_id



class ROSTopicPublish(component):
    def RunScript(self, ros_client, send_geometry, start_button, go_to_position, shoot):
        ### designed waypoints
        topic1_name = '/design_waypoints'
        topic1_type = 'impact_printing_msgs/WaypointStates'
        
        ###digital start button for the tool
        topic2_name = '/controllino/digital_start_button'
        topic2_type = 'std_msgs/Bool'
        
        ###go to position
        topic3_name = '/next_waypoint'
        topic3_type = 'std_msgs/Bool'
        
        ##shoot 
        topic4_name = '/controllino/digital_shoot_button'
        topic4_type = 'std_msgs/Bool'
        
#        
#        
#        if not topic1_name or topic2_name or topic3_name or topic4_name :
#            raise ValueError('Please specify the name of the topic')
#        if not topic1_type or topic2_type or topic3_type or topic4_type:
#            raise ValueError('Please specify the type of the topic')
            
        key1 = create_id(self, 'topic1')
        key2 = create_id(self, 'topic2')
        key3= create_id(self, 'topic3')
        key4= create_id(self, 'topic4')
        
        topic1 = st.get(key1, None)
        topic2 = st.get(key2, None)
        topic3 = st.get(key3, None)
        topic4 = st.get(key4, None)

        if ros_client and ros_client.is_connected:
            if not topic1 or topic1.ros != ros_client:
                topic1 = Topic(ros_client, topic1_name, topic1_type, reconnect_on_close=False)
                topic2 = Topic(ros_client, topic2_name, topic2_type, reconnect_on_close=False)
                topic3 = Topic(ros_client, topic3_name, topic3_type, reconnect_on_close=False)
                topic4 = Topic(ros_client, topic4_name, topic4_type, reconnect_on_close=False)
                topic1.advertise()
                time.sleep(0.2)

                st[key1] = topic1
                st[key2] = topic2
                st[key3] = topic3
                st[key4] = topic4

        self.is_advertised_1 = topic1 and topic1.is_advertised
        self.is_advertised_2 = topic2 and topic2.is_advertised
        self.is_advertised_3 = topic3 and topic3.is_advertised
        self.is_advertised_4 = topic4 and topic4.is_advertised
        
###designed waypoints
        if send_geometry :
            msg1 = send_geometry
#            print type(msg1)
            print msg1
            msg1 = str(send_geometry)
            msg1 = ROSmsg.parse(msg1, topic1_type)
            topic1.publish(msg1.msg)
            self.Message = 'Message published'
        else:
            if self.is_advertised_1:
                self.Message = 'Topic1 advertised'
###start digital button for the tool
        if start_button:
            msg2 = json.dumps({'data': True})
        else:
            msg2 = json.dumps({'data': False})
        msg2 = ROSmsg.parse(msg2, topic2_type)
        topic2.publish(msg2.msg)
        time.sleep(0.1)
        self.Message = 'Message published'
        if self.is_advertised_2:
            self.Message = 'Topic2 advertised'
        

###go to next waypoint
        if go_to_position:
            msg3 = json.dumps({'data': True})
            msg3 = ROSmsg.parse(msg3, topic3_type)
            topic3.publish(msg3.msg)
            time.sleep(0.1)
            self.Message = 'Message published'
        else:
            msg3 = json.dumps({'data': False})
            if self.is_advertised_3:
                self.Message = 'Topic3 advertised'
                
### Shoot !!
        if shoot:
            msg4 = json.dumps({'data': True})
            msg4 = ROSmsg.parse(msg4, topic4_type)
            topic4.publish(msg4.msg)
            time.sleep(0.1)
            self.Message = 'Message published'
        else:
            msg4 = json.dumps({'data': False})
            if self.is_advertised_4:
                self.Message = 'Topic4 advertised'

                return(topic4,self.is_advertised_4)
        return (self.is_advertised_1,self.is_advertised_2, self.is_advertised_3, self.is_advertised_4)
# ---------- end publish_2 ----------
panel_16 = Panel(publish_2.is_advertised_1)

# ==== cluster Cluster
crv = ClusterInput()
A = ClusterInput()
crv_2 = Curve(crv)
multiplication = Multiplication(A=A, B=2)
A_2 = ClusterInput()
explode = Explode(Curve=crv_2, Recursive=True)  # -> Segments, Vertices
F = ClusterInput()
division = Division(A=A_2, B=multiplication)
dispatch = Dispatch(List=explode.Segments, DispatchPattern=[True, False])  # -> ListA, ListB
X = UnitX(Factor=F)
round = Round(Number=division)  # -> Nearest, Floor, Ceiling
extr = Extrude(Base=dispatch.ListA, Direction=X)
neg = Negative(Value=X)
extr_2 = Extrude(Base=dispatch.ListB, Direction=neg)
x = ClusterInput()
flip = Flip(Surface=extr_2)  # -> Surface, Result
neg_2 = Negative(Value=x)
multiplication_2 = Multiplication(A=X, B=2)
multiplication_3 = Multiplication(A=X, B=3)
offsrf = OffsetSurface(Surface=[flip.Surface, extr], Distance=neg_2, BothSides=0, CreateSolid=True)
neg_3 = Negative(Value=multiplication_3)
arrlinear = LinearArray(Geometry=offsrf, Direction=multiplication_2, Count=round.Nearest)  # -> Geometry, Transform
move = Move(Geometry=arrlinear.Geometry, Motion=neg_3)  # -> Geometry, Transform
G = ClusterOutput(move.Geometry)

# ==== cluster Cluster_2
A = ClusterInput()
A_2 = ClusterInput()
G = ClusterInput()
division = Division(A=A, B=2)
division_2 = Division(A=A_2, B=2)
brec = BoundingRectangle(Geometry=G, Plane=PlaneXY(0, 0, 0), Axis=0, Slide=0, Union=True)  # -> Bounding, DimensionX, DimensionY
neg = Negative(Value=division)
neg_2 = Negative(Value=division_2)
X = ClusterInput()
Y = ClusterInput()
area = Area(Geometry=brec.Bounding)  # -> Area, Centroid
X_2 = UnitX(Factor=neg)
Y_2 = UnitY(Factor=neg_2)
rectangle = Rectangle(Plane=area.Centroid, XSize=X, YSize=Y, Radius=0)  # -> Rectangle, Length
addition = Addition(A=X_2, B=Y_2)
x = ClusterInput()
neg_3 = Negative(Value=x)
move = Move(Geometry=rectangle.Rectangle, Motion=addition)  # -> Geometry, Transform
Z = UnitZ(Factor=neg_3)
extr = Extrude(Base=move.Geometry, Direction=Z)
cap = CapHoles(Brep=extr)
B = ClusterOutput(cap)
